# Grasshopper definition devEnv.gh (Grasshopper 1.0.7)

# ---- group: Folder links
# Version Controlling and Deployment
# Links
# replace this link with your folder path
your_local_link_to_source_code = Panel("C:\Users\43310\source\repos\GHPython-Components")

# ---- group: Interact with Github repo
# Github cmds
button = Button()
gsac = GithubStatusAndCommit(
    ToggleGitStatus=button,
    ToggleGitFetch=Button(),
    ToggleGitPull=Button(),
    ToggleGitCommit=Button(),
    ToggleGitPush=Button(),
    CommitMessage="add dev env",
    Folder=your_local_link_to_source_code)
# ---------- gsac: Python ----------
__author__ = "karimd"
__version__ = "2023.04.12"


ghenv.Component.Name = "GithubStatusAndCommit"
ghenv.Component.NickName = "GSAC"
ghenv.Component.Category = "FWDT-Tools"
ghenv.Component.SubCategory = "Automation"

import subprocess

if Folder and ToggleGitStatus:
    directory_path = r"{}".format(Folder)

    # Check Git status
    status_command = 'cmd /k "cd {} && git status"'.format(directory_path)
    subprocess.Popen(status_command)
    
if Folder and ToggleGitFetch:
    directory_path = r"{}".format(Folder)

    command = 'cmd /k "cd {} && git fetch"'.format(directory_path)
    subprocess.Popen(command)

if Folder and ToggleGitPull:
    directory_path = r"{}".format(Folder)

    command = 'cmd /k "cd {} && git pull"'.format(directory_path)
    subprocess.Popen(command)

if Folder and ToggleGitCommit:
    commit_msg = CommitMessage # get commit message from input parameter
    directory_path = r"{}".format(Folder)

    command = 'cmd /k "cd {} && git status && git add . && git commit -m "{}""'.format(directory_path, commit_msg)
    subprocess.Popen(command)

if Folder and ToggleGitPush:
    directory_path = r"{}".format(Folder)

    command = 'cmd /k "cd {} && git push"'.format(directory_path)
    subprocess.Popen(command)
# ---------- end gsac ----------

# ---- group: Update Local GhLibrary from cloned repo
# Replace userobjects
button_2 = Button()
ruowl = ReplaceUserObjectsWithLocal(Toggle=button_2, LocalFolder=your_local_link_to_source_code)  # inputs Toggle: Boolean
# ---------- ruowl: Python ----------
"""
Iterates the GHPython components in the document and makes user objects of them
if the their Category property matches the input Category parameter. Also grabs
all the code and writes this to .py files.

    Input:
        Toggle: Activate the component using a boolean toggle {item,bool}
        Folder: The folder/directory to save the user objects and source code to {item,str}
        Category: The name of the category for which to make user objects {item,str}
    Output:
        TLOC: Lines of code in user object {item,int}
    Remarks:
        Author: Karim Daw
        License: Apache License 2.0
        Version: 230710
"""
ghenv.Component.Name = "ReplaceUserObjectsWithLocal"
ghenv.Component.NickName = "RUOWL"
ghenv.Component.Category = "FWDT-Tools"
ghenv.Component.SubCategory = "Automation"

#this is a test

import os
import Grasshopper as gh
#import getpass
import System.Environment as env

#short variable name of component
gCN = ghenv.Component.Name

# Make GH component warning handler
wh = gh.Kernel.GH_RuntimeMessageLevel.Warning

import os
import shutil

import os
import shutil

def replace_folder(src_folder, dest_folder):
    """
    Delete all files and folders in `dest_folder` with the same name as the contents
    of `src_folder`, and then replace them with the contents of `src_folder`.
    If the files or folders do not exist in the destination directory, they are copied from the source directory.
    """
    
    wh = gh.Kernel.GH_RuntimeMessageLevel.Warning
     
    try:
        # Get a list of all files and folders in the source folder
        src_contents = os.listdir(src_folder)

        # Iterate over the contents of the destination folder
        dest_contents = os.listdir(dest_folder)
        for item in dest_contents:
            # Construct the source and destination paths for the current item
            src_path = os.path.join(src_folder, item)
            dest_path = os.path.join(dest_folder, item)

            # Skip the .git folder and its contents
            if item == ".git":
                continue

            # If the current item exists in the source folder, delete it from the destination folder
            if item in src_contents:
                if os.path.isfile(dest_path):
                    os.remove(dest_path)
                elif os.path.isdir(dest_path):
                    shutil.rmtree(dest_path)

        # Copy the contents of the source folder to the destination folder
        for item in src_contents:
            # Construct the source and destination paths for the current item
            src_path = os.path.join(src_folder, item)
            dest_path = os.path.join(dest_folder, item)

            # If the current item is a file, copy it to the destination folder
            if os.path.isfile(src_path):
                shutil.copy2(src_path, dest_path)

            # If the current item is a folder, recursively replace its contents in the destination folder
            elif os.path.isdir(src_path):
                # Skip the .git folder and its contents
                if item == ".git":
                    continue

                # Create the destination folder if it does not exist
                if not os.path.exists(dest_path):
                    os.makedirs(dest_path)

                # Recursively replace the contents of the current folder in the destination folder
                replace_folder(src_path, dest_path)

        formattedString = "Contents of {} replaced successfully.".format(dest_folder)
        print(formattedString)
        ghenv.Component.AddRuntimeMessage(wh,formattedString)    

    except Exception as e:
        # Handle any exceptions that might occur
        print("Error replacing contents of {}: {}".format(dest_folder, str(e)))



if Toggle and LocalFolder:
    
    # Get user name
    #print(env.UserName)
    # username=getpass.getuser()
    username = env.UserName

    # get local GH componenet folder
    localGhFolder = "C:\\Users\\"+username+"\\AppData\\Roaming\\Grasshopper\\UserObjects\\"
    replace_folder(LocalFolder,localGhFolder)
# ---------- end ruowl ----------

# ----
# Push changes
button_3 = Button()

# ---- group: Pushing changes to all relevant folders
ptuo = GHPythonToUserObject(Toggle=button_3, LocalFolder=your_local_link_to_source_code, Category="FWDT-Tools")  # -> TLOC; inputs Toggle: Boolean
# ---------- ptuo: Python ----------
"""
Iterates the GHPython components in the document and makes user objects of them
if the their Category property matches the input Category parameter. Also grabs
all the code and writes this to .py files.

    Input:
        Toggle: Activate the component using a boolean toggle {item,bool}
        Folder: The folder/directory to save the user objects and source code to {item,str}
        Category: The name of the category for which to make user objects {item,str}
    Output:
        TLOC: Lines of code in user object {item,int}
    Remarks:
        Author: Anders Holden Deleuran
        Contributor: Karim Daw
        License: Apache License 2.0
        Version: 230704
"""
ghenv.Component.Name = "GHPythonToUserObject"
ghenv.Component.NickName = "PTUO"
ghenv.Component.Category = "FWDT-Tools"
ghenv.Component.SubCategory = "Automation"

import os
import Grasshopper as gh
#import getpass
import System.Environment as env

#short variable name of component
gCN = ghenv.Component.Name

# Make GH component warning handler
wh = gh.Kernel.GH_RuntimeMessageLevel.Warning

def ghPythonToUserObject(ghPyComp,writeFolder):
    
    """ 
    Automates the creation of a GHPython user object. Based on this thread:
    http://www.grasshopper3d.com/forum/topics/change-the-default-values-for-userobject-popup-menu
    """
    
    # Make a user object
    uo = gh.Kernel.GH_UserObject()
    
    # Set its properties based on the GHPython component properties
    uo.Icon = ghPyComp.Icon_24x24    
    uo.BaseGuid = ghPyComp.ComponentGuid
    uo.Exposure = ghenv.Component.Exposure.primary
    uo.Description.Name = ghPyComp.Name
    uo.Description.Description = ghPyComp.Description
    uo.Description.Category = ghPyComp.Category
    uo.Description.SubCategory = ghPyComp.SubCategory
    
    # Set the user object data and save to file
    uo.SetDataFromObject(ghPyComp)
    uo.Path = os.path.join(writeFolder,ghPyComp.Name+".ghuser")
    uo.SaveToFile()
    
    # Update the grasshopper ribbon UI (doesn't seem to work)
    gh.Kernel.GH_ComponentServer.UpdateRibbonUI()

def exportGHPythonSource(ghPyComp,writeFolder):
    
    """ Export the source code of a GHPython component """
    
    # Get code and lines of code
    code = ghPyComp.Code
    code = code.replace("\r","")
    lines = code.splitlines()
    loc = len(lines)
    
    # Check/make source file folder
    srcFolder = os.path.join(writeFolder,"src")
    if not os.path.isdir(srcFolder):
        os.makedirs(srcFolder)
        
    # Write code to .py file
    srcFile = os.path.join(srcFolder,ghPyComp.Name + ".py")
    f = open(srcFile,"w")
    f.write(code)
    f.close()
    
    return loc

def saveGhComponent(obj,folder):
    
    ghPythonToUserObject(obj,folder)
    loc = exportGHPythonSource(obj,folder)
    obj.AddRuntimeMessage(wh,"I was just saved as a user object, hooray!")    

def get_user_from_environment():
    a = str(os.path.expanduser('~'))
    a_ls = os.path.split(a)
    return a_ls[-1]


if Toggle and LocalFolder and Category:
    
    # Get user name
    print(env.UserName)
    # username=getpass.getuser()
    username = get_user_from_environment()

    # get local GH componenet folder
    localGhFolder = "C:\Users\\"+username+"\AppData\Roaming\Grasshopper\UserObjects"

    # Iterate the canvas and get to the GHPython components
    TLOC = 0
    for obj in ghenv.Component.OnPingDocument().Objects:

        if type(obj) is type(ghenv.Component):
            
            # Check that category matches and export to files
            if obj.Category == Category:
                
                saveGhComponent(obj,localGhFolder+"\\"+obj.Name)
                saveGhComponent(obj,LocalFolder+"\\"+obj.Name)
# ---------- end ptuo ----------

# ---- group: Pull updated code
# Pull changes
button_4 = Button()
upsc = UpdateGHPythonSourceCode(CheckForUpdate=button_4, UpdateCode=Button(), Folder=your_local_link_to_source_code)  # -> UpdatedComponentNames
# ---------- upsc: Python ----------
"""
Updates the source code of GHPython components on the canvas with the code
in the .py files in the Folder if the GHPython component Name property is 
the same as the name of one of the .py files.

    Inputs:
        CheckForUpdate: Activate the component {item,bool}
        UpdateCode: The location of the .py source code files {item,str}
        Folder: The Folder path with the latest code, can be a github repo or server link
    Outputs:
        UpdatedComponentNames: List of GHPython component names that either need to be update, or have been updated updated {list,str}
    Remarks:
        Author: Anders Holden Deleuran
        Contributor: Karim Daw
        License: Apache License 2.0
        Version: 230411
"""

ghenv.Component.Name = "UpdateGHPythonSourceCode"
ghenv.Component.NickName = "UPSC"
ghenv.Component.Category = "FWDT-Tools"
ghenv.Component.SubCategory = "Automation"

import rhinoscriptsyntax as rs
import os
import Grasshopper as gh
from pprint import pprint


def getSrcCodeVersion(srcCode):
    
    """
    Attempts to get the first instance of the word "version" (or, "Version")
    in a multi line string. Then attempts to extract an integer from this line 
    where the word "version" exists. So format version YYMMDD in the GHPython 
    docstring like so (or any other integer system):
        
        Version: 160121
    """

    
    # Get first line with version in it
    srcCodeLower = srcCode.lower()
    verStr = [l for l in srcCodeLower.split('\n') if "version" in l]
    if verStr:
        
        # Get the first substring integer and return it
        verInt = [int(s) for s in verStr[0].split() if s.isdigit()]
        if verInt:
            return int(verInt[0])
    else:
        return None

def find_py_files(path):
    py_files = []
    for root, dirs, files in os.walk(path):
        if "src" in dirs:
            src_path = os.path.join(root, "src")
            for file in os.listdir(src_path):
                if file.endswith(".py"):
                    py_files.append(os.path.join(src_path, file))

    return py_files

def make_py_file_dictionary(py_files):
    srcCode = {}
    for f in pyFiles:
        fOpen = open(f)
        fRead = fOpen.read()
        filePath,fExt = os.path.splitext(f)
        splitFilePath = filePath.split("\\")
        fileName = splitFilePath[-1]
        srcCode[fileName] = fRead
    return srcCode

def checkForUpdateGHPythonSrc(srcCode, ghDocument):
    
        # Make GH component warning handler
    wh = gh.Kernel.GH_RuntimeMessageLevel.Warning
    
    # Iterate the gh canvas and update ghpython source code
    guids = []
    outOfDateComponentNames = []
    for obj in ghDocument.Objects:
        if type(obj) is type(ghenv.Component):
            if obj.Name in srcCode:
                # Check that srcCode file has higher version number than obj source code
                srcCodeVer = getSrcCodeVersion(srcCode[obj.Name])
                objSrcVer = getSrcCodeVersion(obj.Code)
                if objSrcVer and srcCodeVer > objSrcVer:
                    obj.AddRuntimeMessage(wh,"The source code of this component is out of date, consider update the code")
                    outOfDateComponentNames.append(obj.Name)

    formattedString = ""
    for s in outOfDateComponentNames:
        formattedString += "Component: {} has newer src code\n".format(s)
    return formattedString

def updateGHPythonSrc(srcCode, ghDocument):
    
        # Make GH component warning handler
    wh = gh.Kernel.GH_RuntimeMessageLevel.Warning
    
    # Iterate the gh canvas and update ghpython source code
    guids = []
    updatedComponentNames = []
    for obj in ghDocument.Objects:
        if type(obj) is type(ghenv.Component):
            if obj.Name in srcCode:

                
                # Check that srcCode file has higher version number than obj source code
                srcCodeVer = getSrcCodeVersion(srcCode[obj.Name])
                objSrcVer = getSrcCodeVersion(obj.Code)
                if objSrcVer and srcCodeVer > objSrcVer:
                    
                    # Update the obj source
                    obj.Code = srcCode[obj.Name]
                    obj.AddRuntimeMessage(wh,"GHPython code was automatically updated, input/output parameters might have changed")
                    updatedComponentNames.append(obj.Name)

                    
    formattedString = ""
    for s in updatedComponentNames:
        formattedString += "Updated {} component on canvas\n".format(s)

    ghenv.Component.AddRuntimeMessage(wh,formattedString)                  
    return formattedString

pyFiles = find_py_files(Folder)
srcCodeMap = make_py_file_dictionary(pyFiles)
if CheckForUpdate:
    UpdatedComponentNames = checkForUpdateGHPythonSrc(srcCodeMap,ghenv.Component.OnPingDocument())
if UpdateCode:
    UpdatedComponentNames = updateGHPythonSrc(srcCodeMap,ghenv.Component.OnPingDocument())
# ---------- end upsc ----------
components_that_were_updated = Panel(upsc)
